# Grasshopper definition sine-demo.gh (Grasshopper 0.9.76)

series = Series(Start=Slider(90, range=0..1000), Step=1, Count=Slider(360, range=0..1000))
rad = Radians(Degrees=series)
sin = Sine(Value=rad)
multiplication = Multiplication(A=sin, B=Slider(40, range=0..100))
pt = ConstructPoint(XCoordinate=series, YCoordinate=multiplication, ZCoordinate=0)

intcrv = Interpolate(Vertices=pt, Degree=3, Periodic=False, KnotStyle=1)  # -> Curve, Length, Domain
end = EndPoints(Curve=intcrv.Curve)  # -> Start, End
rad_2 = Radians(Degrees=Slider(180, range=0..1000))
ln = Line(StartPoint=end.End, EndPoint=end.Start)
revsrf = Revolution(Curve=intcrv.Curve, Axis=ln, Domain=rad_2)

bbox = BoundingBox(Content=revsrf, Plane=PlaneXY(0, 0, 0))  # -> Box, Box_2
debox = DeconstructBox(Box=bbox.Box)  # -> Plane, X, Y, Z
dedomain = DeconstructDomain(Domain=debox.X)  # -> Start, End
subtraction = Subtraction(A=dedomain.End, B=dedomain.Start)
series_2 = Series(Start=0, Step=subtraction, Count=Slider(10, range=0..10))
pt_2 = ConstructPoint(XCoordinate=series_2, YCoordinate=0, ZCoordinate=0)

dedomain_2 = DeconstructDomain(Domain=debox.Y)  # -> Start, End
subtraction_2 = Subtraction(A=dedomain_2.End, B=dedomain_2.Start)
series_3 = Series(Start=0, Step=subtraction_2, Count=Slider(10, range=0..10))
vec2pt = Vector2Pt(PointA=end.Start, PointB=pt_2, Unitize=False)  # -> Vector, Length
pt_3 = ConstructPoint(XCoordinate=0, YCoordinate=series_3, ZCoordinate=0)
move = Move(Geometry=revsrf, Motion=vec2pt.Vector)  # -> graft(Geometry), Transform
vec2pt_2 = Vector2Pt(PointA=end.Start, PointB=pt_3, Unitize=False)  # -> Vector, Length
move_2 = Move(Geometry=move.Geometry, Motion=vec2pt_2.Vector)  # -> Geometry, Transform
